# Grasshopper definition graph_dummyData_LV.gh (Grasshopper 0.9.76)

# DUMMY DESK PTS
pipeline = GeometryPipeline(
    GroupByLayer=False,
    GroupByType=False,
    IncludeHidden=True,
    IncludeLocked=True,
    LayerFilter="ws_cubicle_3",
    NameFilter="*",
    TypeFilter=4)
# DUMMY AMENITY CRVS
pipeline_2 = GeometryPipeline(
    GroupByLayer=False,
    GroupByType=False,
    IncludeHidden=True,
    IncludeLocked=True,
    LayerFilter="am_3",
    NameFilter="*",
    TypeFilter=4)
# DUMMY MESH GEO
pipeline_3 = GeometryPipeline(
    GroupByLayer=False,
    GroupByType=False,
    IncludeHidden=True,
    IncludeLocked=True,
    LayerFilter="bound_2",
    NameFilter="*",
    TypeFilter=4)
pipeline_4 = GeometryPipeline(
    GroupByLayer=False,
    GroupByType=False,
    IncludeHidden=True,
    IncludeLocked=True,
    LayerFilter="bound_3",
    NameFilter="*",
    TypeFilter=4)
crv = Curve(pipeline)
crv_2 = Curve(pipeline_2)
crv_3 = Curve(pipeline_3)
crv_4 = Curve(pipeline_4)

# ---- group: branch desk pts by floor
cluster = Cluster(crv=crv)

# ---- group: branch am plines by floor
cluster_2 = Cluster_2(crv=crv_2)

# ----
bang = ExplodeTree(Data=cluster)  # -> Branch0, Branch1
bang_2 = ExplodeTree(Data=cluster_2)  # -> Branch0, Branch1

# ---- group: desk pts FL 2
pt = Point(bang.Branch0)

# ---- group: desk pts FL 3
pt_2 = Point(bang.Branch1)

# ---- group: am crvs FL 2
crv_5 = Curve(bang_2.Branch0)

# ---- group: am crvs FL 3
crv_6 = Curve(bang_2.Branch1)

# ----
number_slider = Slider(1600, range=0..1600)

# ---- group: am crvs
crv_7 = Curve(crv_5)

# ---- group: FL bound crv
crv_8 = Curve(crv_3)

# ---- group: am crvs
crv_9 = Curve(crv_6)

# ---- group: FL bound crv
crv_10 = Curve(crv_4)

# ---- group: create mesh
cluster_3 = Cluster_3(crv_2=crv_7, crv=crv_8, data=number_slider)

cluster_4 = Cluster_4(crv=crv_9, crv_2=crv_10, data=number_slider)

# ---- group: FL 2 mesh
mesh = Mesh(cluster_3)

# ---- group: FL 3 mesh
mesh_2 = Mesh(cluster_4)

# ==== cluster Cluster
crv = ClusterInput()
crv_2 = Curve(crv)
area = Area(Geometry=crv_2)  # -> Area, Centroid
pdecon = Deconstruct(Point=area.Centroid)  # -> XComponent, YComponent, ZComponent
round = Round(Number=pdecon.ZComponent)  # -> Nearest, Floor, Ceiling
int = Integer(round.Nearest)
sort = SortList(Keys=int)  # -> Keys, ValuesA
dcon = DeleteConsecutive(Set=sort.Keys, Wrap=False)  # -> Set, Count
equals = Equality(FirstNumber=int, SecondNumber=graft(dcon.Set))  # -> Equality, Inequality
dispatch = Dispatch(List=area.Centroid, DispatchPattern=equals.Equality)  # -> ListA, ListB
pt = Point(dispatch.ListA)
pt_2 = ClusterOutput(pt)

# ==== cluster Cluster_2
crv = ClusterInput()
crv_2 = Curve(crv)
area = Area(Geometry=crv_2)  # -> Area, Centroid
pdecon = Deconstruct(Point=area.Centroid)  # -> XComponent, YComponent, ZComponent
round = Round(Number=pdecon.ZComponent)  # -> Nearest, Floor, Ceiling
int = Integer(round.Nearest)
sort = SortList(Keys=int)  # -> Keys, ValuesA
dcon = DeleteConsecutive(Set=sort.Keys, Wrap=False)  # -> Set, Count
equals = Equality(FirstNumber=int, SecondNumber=graft(dcon.Set))  # -> Equality, Inequality
dispatch = Dispatch(List=crv_2, DispatchPattern=equals.Equality)  # -> ListA, ListB
crv_3 = Curve(dispatch.ListA)
crv_4 = ClusterOutput(crv_3)

# ==== cluster Cluster_3
crv = ClusterInput()
crv_2 = ClusterInput()
data = ClusterInput()
crv_3 = Curve(crv_2)
crv_4 = Curve(crv)
boundary = BoundarySurfaces(Edges=crv_4)
rdiff = RegionDifference(CurvesA=boundary, CurvesB=crv_3)
data_2 = Data(data)
boundary_2 = BoundarySurfaces(Edges=rdiff)
custom_mesh_settings = SettingsCustom(
    StitchSeams=True,
    SimplePlanes=False,
    Refine=True,
    MinCount=data_2,
    MaxCount=400,
    AspectRatio=20,
    MaxDistance=0,
    MaxAngle=20,
    MinEdge=0,
    MaxEdge=0)
mesh = MeshBrep(Brep=boundary_2, Settings=custom_mesh_settings)
M = ClusterOutput(mesh)

# ==== cluster Cluster_4
crv = ClusterInput()
crv_2 = ClusterInput()
crv_3 = Curve(crv)
crv_4 = Curve(crv_2)
boundary = BoundarySurfaces(Edges=crv_4)
data = ClusterInput()
rdiff = RegionDifference(CurvesA=boundary, CurvesB=crv_3)
data_2 = Data(data)
boundary_2 = BoundarySurfaces(Edges=rdiff)
custom_mesh_settings = SettingsCustom(
    StitchSeams=True,
    SimplePlanes=False,
    Refine=True,
    MinCount=data_2,
    MaxCount=400,
    AspectRatio=20,
    MaxDistance=0,
    MaxAngle=20,
    MinEdge=0,
    MaxEdge=0)
mesh = MeshBrep(Brep=boundary_2, Settings=custom_mesh_settings)
M = ClusterOutput(mesh)
