# Grasshopper definition makeGraph.gh (Grasshopper 0.9.76)
# plug-ins: Python Interpreter, HDTReference

pipeline = GeometryPipeline(
    GroupByLayer=False,
    GroupByType=False,
    IncludeHidden=True,
    IncludeLocked=True,
    LayerFilter="srf",
    NameFilter="*",
    TypeFilter=1073741848)
mesh = MeshBrep(
    Brep=pipeline,
    Settings={GridMaxCount=0, GridMinCount=16, JaggedSeams=False, MaxEdgeLength=0, MinEdgeLength=0.0001, MinTolerance=0, Refine=True, RefineAngle=0, RelativeTolerance=0.65, SimplePlanes=True, Tolerance=0})
mplane = MeshPlane(Boundary={Plane=PlaneXY(0, 0, 0), Size=Domain2(u=-10..10, v=-10..10)}, WidthCount=10, HeightCount=10)  # -> Mesh, Area; disabled
tri = Triangulate(Mesh=mplane.Mesh)  # -> Mesh, Count; disabled
demesh = DeconstructMesh(Mesh=mesh)  # -> Vertices, Faces, Colours, Normals
pipeline_2 = GeometryPipeline(
    GroupByLayer=False,
    GroupByType=False,
    IncludeHidden=True,
    IncludeLocked=True,
    LayerFilter="start",
    NameFilter="*",
    TypeFilter=1)
pipeline_3 = GeometryPipeline(
    GroupByLayer=False,
    GroupByType=False,
    IncludeHidden=True,
    IncludeLocked=True,
    LayerFilter="end",
    NameFilter="*",
    TypeFilter=1)
deface = DeconstructFace(Face=demesh.Faces)  # -> CornerA, CornerB, CornerC, CornerD
python = PythonScript(a=deface.CornerA, b=deface.CornerB, c=deface.CornerC, d=deface.CornerD)  # -> out, nl; inputs a: list, b: list, c: list, d: list
# ---------- python: Python ----------
import pickle

nodeLists = []

for i, i_a in enumerate(a):
    i_b = b[i]
    i_c = c[i]
    i_d = d[i]
    
    nodeLists.append(list(set([i_a, b[i], c[i], d[i]])))

nl = pickle.dumps(nodeLists)
# ---------- end python ----------
cp = ClosestPoint(Point=pipeline_2, Cloud=demesh.Vertices)  # -> ClosestPoint, CPIndex, Distance
cp_2 = ClosestPoint(Point=pipeline_3, Cloud=demesh.Vertices)  # -> ClosestPoint, CPIndex, Distance
make_graph = PythonScript(nodes=demesh.Vertices, nl=python.nl)  # -> out, g; inputs nodes: list
# ---------- make_graph: Python ----------
import rhinoscriptsyntax as rs
import math
import pickle

def dist(pt1, pt2):
    return math.sqrt((pt1[0] - pt2[0])**2 + (pt1[1] - pt2[1])**2 + (pt1[2] - pt2[2])**2)

edgeLists = pickle.loads(nl)

graph = {}
graph["nodes"] = []
graph["edges"] = {}

for node in nodes:
    pt = rs.coerce3dpoint(node)
    graph["nodes"].append({"coords": [pt.X, pt.Y, pt.Z]})

for i in range(len(edgeLists)):
    ptSet = edgeLists[i]
    
    for j, index in enumerate(ptSet):
        
        prevIndex = ptSet[j-1]
        diagIndex = ptSet[j-2]
        
        if index not in graph["edges"].keys():
            graph["edges"][index] = {}
        if prevIndex not in graph["edges"].keys():
            graph["edges"][prevIndex] = {}
        
        dist_edge = dist(graph["nodes"][index]["coords"], graph["nodes"][prevIndex]["coords"])
        
        if prevIndex not in graph["edges"][index]:
            graph["edges"][index][prevIndex] = dist_edge
        if index not in graph["edges"][prevIndex]:
            graph["edges"][prevIndex][index] = dist_edge
        
        if len(ptSet) == 4:
            if diagIndex not in graph["edges"].keys():
                graph["edges"][diagIndex] = {}
            dist_diag = dist(graph["nodes"][index]["coords"], graph["nodes"][diagIndex]["coords"])
            if diagIndex not in graph["edges"][index]:
                graph["edges"][index][diagIndex] = dist_diag

g = pickle.dumps(graph)
# ---------- end make_graph ----------
dijkstra = PythonScript(g=make_graph.g, start=cp.CPIndex, end=cp_2.CPIndex)  # -> out, a
# ---------- dijkstra: Python ----------
from __future__ import generators
import pickle

graph = pickle.loads(g)


class priorityDictionary(dict):
    def __init__(self):
#        '''Initialize priorityDictionary by creating binary heap
#of pairs (value,key).  Note that changing or removing a dict entry will
#not remove the old pair from the heap until it is found by smallest() or
#until the heap is rebuilt.'''
        self.__heap = []
        dict.__init__(self)

    def smallest(self):
        '''Find smallest item after removing deleted items from heap.'''
        if len(self) == 0:
            raise IndexError, "smallest of empty priorityDictionary"
        heap = self.__heap
        while heap[0][1] not in self or self[heap[0][1]] != heap[0][0]:
            lastItem = heap.pop()
            insertionPoint = 0
            while 1:
                smallChild = 2*insertionPoint+1
                if smallChild+1 < len(heap) and \
                        heap[smallChild] > heap[smallChild+1]:
                    smallChild += 1
                if smallChild >= len(heap) or lastItem <= heap[smallChild]:
                    heap[insertionPoint] = lastItem
                    break
                heap[insertionPoint] = heap[smallChild]
                insertionPoint = smallChild
        return heap[0][1]
	
    def __iter__(self):
        '''Create destructive sorted iterator of priorityDictionary.'''
        def iterfn():
            while len(self) > 0:
                x = self.smallest()
                yield x
                del self[x]
        return iterfn()
	
    def __setitem__(self,key,val):
#        '''Change value stored in dictionary and add corresponding
#pair to heap.  Rebuilds the heap if the number of deleted items grows
#too large, to avoid memory leakage.'''
        dict.__setitem__(self,key,val)
        heap = self.__heap
        if len(heap) > 2 * len(self):
            self.__heap = [(v,k) for k,v in self.iteritems()]
            self.__heap.sort()  # builtin sort likely faster than O(n) heapify
        else:
            newPair = (val,key)
            insertionPoint = len(heap)
            heap.append(None)
            while insertionPoint > 0 and \
                    newPair < heap[(insertionPoint-1)//2]:
                heap[insertionPoint] = heap[(insertionPoint-1)//2]
                insertionPoint = (insertionPoint-1)//2
            heap[insertionPoint] = newPair
	
    def setdefault(self,key,val):
        '''Reimplement setdefault to call our customized __setitem__.'''
        if key not in self:
            self[key] = val
        return self[key]


def Dijkstra(G,start,end=None):
	"""
	Find shortest paths from the start vertex to all
	vertices nearer than or equal to the end.

	The input graph G is assumed to have the following
	representation: A vertex can be any object that can
	be used as an index into a dictionary.  G is a
	dictionary, indexed by vertices.  For any vertex v,
	G[v] is itself a dictionary, indexed by the neighbors
	of v.  For any edge v->w, G[v][w] is the length of
	the edge.  This is related to the representation in
	<http://www.python.org/doc/essays/graphs.html>
	where Guido van Rossum suggests representing graphs
	as dictionaries mapping vertices to lists of neighbors,
	however dictionaries of edges have many advantages
	over lists: they can store extra information (here,
	the lengths), they support fast existence tests,
	and they allow easy modification of the graph by edge
	insertion and removal.  Such modifications are not
	needed here but are important in other graph algorithms.
	Since dictionaries obey iterator protocol, a graph
	represented as described here could be handed without
	modification to an algorithm using Guido's representation.

	Of course, G and G[v] need not be Python dict objects;
	they can be any other object that obeys dict protocol,
	for instance a wrapper in which vertices are URLs
	and a call to G[v] loads the web page and finds its links.
	
	The output is a pair (D,P) where D[v] is the distance
	from start to v and P[v] is the predecessor of v along
	the shortest path from s to v.
	
	Dijkstra's algorithm is only guaranteed to work correctly
	when all edge lengths are positive. This code does not
	verify this property for all edges (only the edges seen
 	before the end vertex is reached), but will correctly
	compute shortest paths even for some graphs with negative
	edges, and will raise an exception if it discovers that
	a negative edge has caused it to make a mistake.
	"""

	D = {}	# dictionary of final distances
	P = {}	# dictionary of predecessors
	Q = priorityDictionary()   # est.dist. of non-final vert.
	Q[start] = 0
	
	for v in Q:
		D[v] = Q[v]
		if v == end: break
		
		for w in G[v]:
			vwLength = D[v] + G[v][w]
			if w in D:
				if vwLength < D[w]:
					raise ValueError, \
  "Dijkstra: found better path to already-final vertex"
			elif w not in Q or vwLength < Q[w]:
				Q[w] = vwLength
				P[w] = v
	
	return (D,P)
			
def shortestPath(G,start,end):
	"""
	Find a single shortest path from the given start vertex
	to the given end vertex.
	The input has the same conventions as Dijkstra().
	The output is a list of the vertices in order along
	the shortest path.
	"""

	D,P = Dijkstra(G,start,end)
	Path = []
	while 1:
		Path.append(end)
		if end == start: break
		end = P[end]
	Path.reverse()
	return Path

a = shortestPath(graph["edges"], start, end)
# ---------- end dijkstra ----------
item = ListItem(List=demesh.Vertices, Index=dijkstra.a, Wrap=True)
pline = PolyLine(Vertices=item, Closed=False)
previewlw = CustomPreviewLineweights(
    Geometry=pline,
    Shader={ambient=RGB(0, 0, 0), diffuse=RGB(255, 105, 180), emission=RGB(76, 32, 54), shine=0.5, specular=RGB(255, 255, 255), transparency=0},
    Thickness=Slider(7.8, range=0..10))
