# Grasshopper definition m-01.gh (Grasshopper 0.9.76)
# plug-ins: Python Interpreter

# ----
# GEOMETRY GENERATION
panel = Panel("inputs.csv")
py_curr_dir = PythonScript(in_name=panel)  # -> out, gh_file, gh_dir, out_file
# ---------- py_curr_dir: Python ----------
gh_file = ghenv.Component.OnPingDocument().FilePath

gh_l = len( gh_file.split('\\')[-1] )

gh_dir = gh_file[:-gh_l]
print(gh_file, gh_dir)
out_file = gh_dir + in_name
# ---------- end py_curr_dir ----------
current_dir_files = Panel([py_curr_dir.gh_file, py_curr_dir.gh_dir, py_curr_dir.out_file])

file = ReadFile(File="C:\test\mars_workflow\data\inputs.csv", PerLineParse=True)
panel_2 = Panel(file)
multiplication = Multiplication(A=file, B=1)  # -> flatten(Result)
python = PythonScript(x=multiplication)  # -> out, a, b, c; inputs x: list
# ---------- python: Python ----------
list = []
a = []
b = []
c = []
for i in x:
    print(i, int(i), int((i-int(i))*100))
    a.append(int(i))
    b.append(int((i-int(i))*10) )
    c.append( int(i * 100))
# ---------- end python ----------
panel_3 = Panel(python.a)
panel_4 = Panel(python.b)

# ---- group: Num of Neighbourhoods
number_slider = Slider(15, range=10..24)

# ---- group: X
genes = GenePool(
    Decimals=1,
    Maximum=10,
    Minimum=0,
    Value=[6.775146172, 4.506252876, 3.144050489, 5.15736433, 2.940061578, 1.071129186, 8.489269041, 0.7861307081, 1.054933146, 8.6542068, 3.00143602, 0.3871870136, 7.630523158, 2.586154948, 7.362676923])

# ---- group: Y
genes_2 = GenePool(
    Decimals=1,
    Maximum=10,
    Minimum=0,
    Value=[4.429178962, 7.169641721, 0.1131170337, 2.3868472, 2.723898484, 0.2327673837, 2.832822442, 8.301278175, 4.367901522, 8.21526051, 6.299431183, 0.5003915031, 0.2496948933, 7.564163281, 9.109195098])

# ---- group: AM_EDGE
genes_3 = GenePool(
    Decimals=1,
    Maximum=1,
    Minimum=0,
    Value=[0.05998136991, 0.2603245877, 0.8572481036, 0.1742087059, 0.4386748511, 0.3852514305, 0.6867719617, 0.1176402611, 0.240801769, 0.5817254431, 0.5555043554, 0.8964603478, 0.4348919133, 0.6343656353, 0.4902821023])

# ----
# INPUTS
panel_5 = Panel(python.b)
panel_6 = Panel(python.c)
panel_7 = Panel(python.a)
xy_use_csv = BooleanToggle(False)
am_edge_use_csv = BooleanToggle(False)
neighborhood_use_csv = BooleanToggle(False)
item = ListItem(List=file, Index="27", Wrap=True)
cluster = Cluster(bool=xy_use_csv, L_2=panel_7, L=genes)  # -> flatten(data_2)
cluster_2 = Cluster(bool=xy_use_csv, L_2=panel_5, L=genes_2)  # -> flatten(data_2)
cluster_3 = Cluster(bool=am_edge_use_csv, L_2=panel_6, L=genes_3)
remap = RemapNumbers(Value=cluster, Source=Domain(0, 10), Target=Domain(-20, 20))  # -> Mapped, Clipped
series = Series(Start=0, Step=1, Count=number_slider)
remap_2 = RemapNumbers(Value=cluster_2, Source=Domain(0, 10), Target=Domain(-10, 10))  # -> Mapped, Clipped
series_2 = Series(Start=0, Step=1, Count=number_slider)
remap_3 = RemapNumbers(Value=cluster_3, Source=Domain(0, 1), Target="0 to 2")  # -> Mapped, Clipped
cluster_4 = Cluster(bool=neighborhood_use_csv, L_2=item, L=number_slider)  # -> flatten(data_2)
item_2 = ListItem(List=remap.Mapped, Index=series, Wrap=True)
item_3 = ListItem(List=remap_2.Mapped, Index=series_2, Wrap=True)
data = Data(item_2)
data_2 = Data(item_3)
int = Integer(remap_3.Mapped)
data_3 = Data(cluster_4)

# ---- group: NEIGHBORHOOD DISTRIBUTION
panel_8 = Panel("""6
2
2
5""")

# ---- group: RHINO_AXIS_CRVS
pipeline = GeometryPipeline(
    GroupByLayer=False,
    GroupByType=False,
    IncludeHidden=True,
    IncludeLocked=True,
    LayerFilter="00_axis",
    NameFilter="*",
    TypeFilter=4)

# ---- group: NEIGHBORHOOD GENERATION / Axis Sub Domain
number_slider_2 = Slider(0.1, range=0..1)

# ---- group: NEIGHBORHOOD GENERATION / RHINO_BOUNDARY_CRVS
pipeline_2 = GeometryPipeline(
    GroupByLayer=False,
    GroupByType=False,
    IncludeHidden=True,
    IncludeLocked=True,
    LayerFilter="fixed_bo_input",
    NameFilter="*",
    TypeFilter=4)

# ---- group: NEIGHBORHOOD GENERATION / Neighbourhood Offset
number_slider_3 = Slider(0, range=0..4)

# ---- group: RHINO_EXT_CRVS
pipeline_3 = GeometryPipeline(
    GroupByLayer=False,
    GroupByType=False,
    IncludeHidden=True,
    IncludeLocked=True,
    LayerFilter="00_ext",
    NameFilter="*",
    TypeFilter=4)

# ---- group: AMENITY BAR SIZING / Am Offset
number_slider_4 = Slider(15, range=0..100)

# ---- group: RHINO_MESHCULL_CRVS
pipeline_4 = GeometryPipeline(
    GroupByLayer=False,
    GroupByType=False,
    IncludeHidden=True,
    IncludeLocked=True,
    LayerFilter="fixed_bo_mesh_cull",
    NameFilter="*",
    TypeFilter=4)

# ---- group: RHINO_MESH_CRVS
pipeline_5 = GeometryPipeline(
    GroupByLayer=False,
    GroupByType=False,
    IncludeHidden=True,
    IncludeLocked=True,
    LayerFilter="fixed_bo_mesh",
    NameFilter="*",
    TypeFilter=4)

# ----
crv = Curve(pipeline_4)
crv_2 = Curve(pipeline_5)

# ---- group: FL bound crv
crv_3 = Curve(crv_2)

# ---- group: DESK GENERATION / DESK WIDTH
number_slider_5 = Slider(6, range=0..10)

# ---- group: DESK GENERATION / DESK SPACING
number_slider_6 = Slider(12, range=0..20)

# ----
series_3 = Series(Start=0, Step=1, Count=number_slider)
panel_9 = Panel(series_3)
int_2 = Integer(panel_9)

# ---- group: RHINO_MESH_CRVS
pipeline_6 = GeometryPipeline(
    GroupByLayer=False,
    GroupByType=False,
    IncludeHidden=True,
    IncludeLocked=True,
    LayerFilter="00_movecrv",
    NameFilter="*",
    TypeFilter=4)

# ---- group: NEIGHBORHOOD GENERATION
crv_4 = Curve(pipeline)
divide = DivideCurve(Curve=crv_4, Count=Slider(2, range=0..10), Kinks=False)  # -> Points, Tangents, Parameters
item_4 = ListItem(List=divide.Points, Index=Slider(1, range=0..1), Wrap=True)  # -> flatten(Item)
crv_5 = Curve(crv_4)
pdecon = Deconstruct(Point=item_4)  # -> XComponent, YComponent, ZComponent
panel_10 = Panel("3")
subtraction = Subtraction(A="1", B=number_slider_2)
dom = ConstructDomain(DomainStart=number_slider_2, DomainEnd=subtraction)
item_5 = ListItem(List=panel_8, Index=0, Wrap=True)
item_6 = ListItem(List=panel_8, Index=Slider(1, range=0..1), Wrap=True)
item_7 = ListItem(List=panel_8, Index=Slider(2, range=0..10), Wrap=True)
item_8 = ListItem(List=panel_8, Index=Slider(3, range=0..10), Wrap=True)
data_4 = Data(flatten(panel_8))
addition = Addition(A=item_7, B=item_8)
addition_2 = Addition(A=item_5, B=item_6)
num_f2 = Number(addition)
num_f3 = Number(addition_2)
data_5 = Data(data)
data_6 = Data(data_2)
xy = XYPlane(Origin=Point(0, 0, 0))
crv_6 = Curve(pipeline_2)
data_7 = Data(number_slider_3)
neg = Negative(Value=data_7)

# ---- group: NEIGHBORHOOD GENERATION / Y-SORT
sort = SortList(Keys=pdecon.YComponent, ValuesA=crv_5)  # -> Keys, ValuesA
item_9 = ListItem(List=sort.ValuesA, Index=0, Wrap=True)
item_10 = ListItem(List=sort.ValuesA, Index="1", Wrap=True)

# ---- group: NEIGHBORHOOD GENERATION / X-SORT
sort_2 = SortList(Keys=pdecon.XComponent, ValuesA=crv_5)  # -> Keys, ValuesA
item_11 = ListItem(List=sort_2.ValuesA, Index=panel_10, Wrap=True)
item_12 = ListItem(List=sort_2.ValuesA, Index="1", Wrap=True)

# ---- group: NEIGHBORHOOD GENERATION (continued)
merge = Merge(Data1=item_9, Data2=item_12, Data3=item_11, Data4=item_10)
subcrv = SubCurve(BaseCurve=reparameterize(merge), Domain=dom)
divide_2 = DivideCurve(Curve=simplify(graft(subcrv)), Count=expr("x-1", simplify(graft(data_4))), Kinks=False)  # -> Points, Tangents, Parameters
hframe = HorizontalFrame(Curve=subcrv, Parameter=flatten(divide_2.Parameters))
deplane = DeconstructPlane(Plane=hframe)  # -> Origin, XAxis, YAxis, ZAxis

# ---- group: NEIGHBORHOOD GENERATION / Neighb Seeds
pt = Point(flatten(divide_2.Points))

# ---- group: NEIGHBORHOOD GENERATION / X
vec = Vector(deplane.XAxis)

# ---- group: NEIGHBORHOOD GENERATION / Y
vec_2 = Vector(deplane.YAxis)

# ---- group: NEIGHBORHOOD GENERATION / X
vec_3 = Vector(vec)

# ---- group: NEIGHBORHOOD GENERATION / Y
vec_4 = Vector(vec_2)

# ---- group: NEIGHBORHOOD GENERATION (continued)
lng = ListLength(List=pt)
dom_2 = ConstructDomain(DomainStart=0, DomainEnd=expr("x-1", lng))
dom_3 = ConstructDomain(DomainStart=0, DomainEnd=expr("x-1", lng))
subset = SubList(List=data_6, Domain=dom_3, Wrap=True)  # -> List, Index
subset_2 = SubList(List=data_5, Domain=dom_2, Wrap=True)  # -> List, Index
amp = Amplitude(Vector=vec_3, Amplitude=subset.List)
amp_2 = Amplitude(Vector=vec_4, Amplitude=subset_2.List)
move = Move(Geometry=pt, Motion=amp)  # -> Geometry, Transform
move_2 = Move(Geometry=move.Geometry, Motion=amp_2)  # -> Geometry, Transform

# ---- group: NEIGHBORHOOD GENERATION / Neighb Seeds
pt_2 = Point(flatten(move_2.Geometry))

# ---- group: NEIGHBORHOOD GENERATION (continued)
voronoi = Voronoi(Points=pt_2, Radius="100", Plane=xy, BruteForceOverride=False)  # -> flatten(Cells)
clean = CleanTree(RemoveNulls=True, RemoveInvalid=True, RemoveEmpty=False, Tree=voronoi)
rdiff = RegionDifference(CurvesA=clean, CurvesB=crv_6)
offset = Offset(Curve=rdiff, Distance=neg, Plane=PlaneXY(0, 0, 0), Corners=1)  # -> flatten(Curve)
crv_7 = Curve(offset)
area = Area(Geometry=crv_7)  # -> Area, Centroid
panel_11 = Panel(area.Area)
larger = LargerThan(FirstNumber=area.Area, SecondNumber=Slider(250, range=0..250))  # -> LargerThan, OrEqualTo
cull = CullPattern(List=crv_7, CullPattern=larger.LargerThan)

# ----
crv_neighborhood_bounds = Curve(cull)

# ---- group: AMENITY WINDOW EDGE / Neighb Bo
crv_8 = Curve(crv_neighborhood_bounds)

# ---- group: AMENITY WINDOW EDGE
index = Data(simplify(graft(int)))
explode = Explode(Curve=crv_8, Recursive=True)  # -> Segments, Vertices
area_2 = Area(Geometry=crv_8)  # -> Area, Centroid
geo = Geometry(explode.Segments)
exterior_lines = Curve(pipeline_3)
len = Length(Curve=geo)
divide_3 = DivideCurve(Curve=geo, Count=Slider(3, range=0..10), Kinks=False)  # -> Points, Tangents, Parameters
divdist = DivideDistance(Curve=exterior_lines, Distance=Slider(1, range=0..10))  # -> flatten(Points), Tangents, Parameters
item_13 = ListItem(List=divide_3.Points, Index="1", Wrap=True)
cp = ClosestPoint(Point=item_13, Cloud=flatten(divdist.Points))  # -> ClosestPoint, CPIndex, Distance
lng_2 = ListLength(List=geo)
partition = PartitionList(List=flatten(cp.Distance), Size=flatten(lng_2))
eval = Evaluate(F="x > y", x=partition, y=Slider(2, range=0..100))
dispatch = Dispatch(List=geo, DispatchPattern=eval)  # -> ListA, ListB
geo_2 = Geometry(dispatch.ListA)
len_2 = Length(Curve=geo_2)
eval_2 = Evaluate(F="x > y", x=len_2, y=Slider(25, range=0..100))
dispatch_2 = Dispatch(List=geo_2, DispatchPattern=eval_2)  # -> ListA, ListB
item_14 = ListItem(List=dispatch_2.ListA, Index=index, Wrap=True)

# ---- group: AMENITY BAR SIZING
ma = MassAddition(Input=flatten(len))  # -> Result, PartialResults
multiplication_2 = Multiplication(A=ma.Result, B=Slider(3.5, range=0..10))
panel_12 = Panel(multiplication_2)
target_area = Slider(10410, range=0..100000)
division = Division(A=target_area, B=multiplication_2)
multiplication_3 = Multiplication(A=division, B=number_slider_4)
python_2 = PythonScript(x=multiplication_3)  # -> out, a
# ---------- python_2: Python ----------
if x < 14:
    a = 14
else:
    a = x
# ---------- end python_2 ----------
data_8 = Data(multiplication_3)
panel_13 = Panel(data_8)

# ----
crv_9 = Curve(item_14)
data_9 = Data(data_8)
crv_10 = Curve(crv_8)

# ---- group: AMENITY GENERATION
curvepoint = PointOnCurve(crv_9, parameter=0.5)
scale = Scale(Geometry=crv_9, Center=curvepoint, Factor=Slider(1.26, range=1..1.5))  # -> Geometry, Transform
neg_2 = Negative(Value=data_9)
crv_11 = Curve(scale.Geometry)
offset_2 = Offset(Curve=graft(crv_11), Distance=[neg_2, data_9], Plane=PlaneXY(0, 0, 0), Corners=1)
trim = TrimTree(Tree=offset_2, Depth=1)  # -> simplify(Tree)
pt_3 = Point(graft(area_2.Centroid))
crv_cp = CurveClosestPoint(Point=pt_3, Curve=trim)  # -> Point, Parameter, Distance
sort_3 = SortList(Keys=crv_cp.Distance, ValuesA=trim)  # -> Keys, ValuesA
item_15 = ListItem(List=sort_3.ValuesA, Index=0, Wrap=True)
crv_12 = Curve(item_15)
crv_13 = Curve(crv_11)
curvepoint_2 = PointOnCurve(crv_12, parameter=0.5)
end = EndPoints(Curve=crv_13)  # -> Start, End
rec_3pt = Rectangle3Pt(PointA=end.Start, PointB=end.End, PointC=curvepoint_2)  # -> Rectangle, Length
rdiff_2 = RegionDifference(CurvesA=simplify(graft(crv_10)), CurvesB=simplify(rec_3pt.Rectangle))
rdiff_3 = RegionDifference(CurvesA=simplify(rec_3pt.Rectangle), CurvesB=simplify(graft(crv_10)))
crv_14 = Curve(rdiff_3)
rdiff_4 = RegionDifference(CurvesA=simplify(rec_3pt.Rectangle), CurvesB=simplify(crv_14))
area_3 = Area(Geometry=rdiff_4)  # -> Area, Centroid
scale_2 = Scale(Geometry=rdiff_4, Center=area_3.Centroid, Factor=Slider(0.8, range=0..1))  # -> Geometry, Transform
total_not_fixed_area = Panel("36406")
tot_num_of_autodesk_employee = Panel("277")
division_2 = Division(A=total_not_fixed_area, B=tot_num_of_autodesk_employee)

# ---- group: AMENITY GENERATION / Workspace Area
crv_15 = Curve(flatten(rdiff_2))

# ---- group: AMENITY GENERATION / Potential Amenity Area
crv_16 = Curve(scale_2.Geometry)

# ---- group: AMENITY_BND_CRVS
crv_am_boundary_crvs = Curve(simplify(flatten(crv_16)))

# ---- group: DESK GENERATION
crv_17 = Curve(crv_am_boundary_crvs)
crv_18 = Curve(crv_neighborhood_bounds)
boundary = BoundarySurfaces(Edges=crv_18)
rdiff_5 = RegionDifference(CurvesA=boundary, CurvesB=crv_17)
boundary_2 = BoundarySurfaces(Edges=rdiff_5)
srf = Surface(boundary_2)
desk_depth = Slider(2.5, range=0..10)
bbox = BoundingBox(Content=srf, Plane=PlaneXY(0, 0, 0))  # -> Box, Box_2
debox = DeconstructBox(Box=bbox.Box)  # -> Plane, X, Y, Z
dedomain = DeconstructDomain(Domain=debox.X)  # -> Start, End
dedomain_2 = DeconstructDomain(Domain=debox.Y)  # -> Start, End
subtraction_2 = Subtraction(A=dedomain.Start, B=dedomain.End)
subtraction_3 = Subtraction(A=dedomain_2.Start, B=dedomain_2.End)
abs = Absolute(Value=subtraction_2)
abs_2 = Absolute(Value=subtraction_3)
division_3 = Division(A=abs, B=abs_2)
larger_2 = LargerThan(FirstNumber=division_3, SecondNumber="1")  # -> LargerThan, OrEqualTo
cull_2 = CullPattern(List=srf, CullPattern=larger_2.LargerThan)
cull_3 = CullPattern(List=srf, CullPattern=invert(larger_2.LargerThan))
vec_5 = VectorXYZ(XComponent=0, YComponent="1", ZComponent=0)  # -> Vector, Length
vec_6 = VectorXYZ(XComponent="1", YComponent=0, ZComponent=0)  # -> Vector, Length
contour = Contour(Shape=cull_2, Point=Point(0, 0, 0), Direction=vec_6.Vector, Distance=number_slider_6)  # -> simplify(flatten(Contours))
contour_2 = Contour(Shape=cull_3, Point=Point(0, 0, 0), Direction=vec_5.Vector, Distance=number_slider_6)  # -> simplify(flatten(Contours))
crv_19 = Curve(contour)
crv_20 = Curve(contour_2)
divdist_2 = DivideDistance(Curve=crv_19, Distance=number_slider_5)  # -> Points, Tangents, Parameters
crv_am_bnds = Curve(crv_am_boundary_crvs)
divdist_3 = DivideDistance(Curve=crv_20, Distance=number_slider_5)  # -> Points, Tangents, Parameters
crv_n_bnds = Curve(crv_neighborhood_bounds)
pt_4 = Point(divdist_2.Points)
pt_5 = Point(divdist_3.Points)
offset_3 = Offset(Curve=crv_am_bnds, Distance=Slider(6, range=0..10), Plane=PlaneXY(0, 0, 0), Corners=1)
offset_4 = Offset(Curve=crv_n_bnds, Distance=Slider(-4, range=-10..10), Plane=PlaneXY(0, 0, 0), Corners=1)
offset_5 = Offset(Curve=crv_am_bnds, Distance=Slider(6, range=0..10), Plane=PlaneXY(0, 0, 0), Corners=1)
offset_6 = Offset(Curve=crv_n_bnds, Distance=Slider(-2, range=-10..10), Plane=PlaneXY(0, 0, 0), Corners=1)
incurves = PointInCurves(Point=simplify(pt_4), Curves=flatten(offset_3))  # -> Relationship, Index, Point
incurves_2 = PointInCurves(Point=simplify(pt_5), Curves=flatten(offset_5))  # -> Relationship, Index, Point
cull_4 = CullPattern(List=pt_4, CullPattern=invert(incurves.Relationship))
incurves_3 = PointInCurves(Point=simplify(cull_4), Curves=flatten(offset_4))  # -> Relationship, Index, Point
cull_5 = CullPattern(List=pt_5, CullPattern=invert(incurves_2.Relationship))
incurves_4 = PointInCurves(Point=simplify(cull_5), Curves=flatten(offset_6))  # -> Relationship, Index, Point
cull_6 = CullPattern(List=cull_4, CullPattern=incurves_3.Relationship)  # -> flatten(List)
cull_7 = CullPattern(List=cull_5, CullPattern=incurves_4.Relationship)  # -> flatten(List)
rad = Radians(Degrees=Slider(90, range=0..100))
rad_2 = Radians(Degrees=Slider(90, range=0..100))
vrot = Rotate(Vector=vec_6.Vector, Axis="0,0,1", Angle=rad)
vrot_2 = Rotate(Vector=vec_5.Vector, Axis="0,0,1", Angle=rad_2)
line = LineSDL(Start=cull_6, Direction=vrot, Length=number_slider_5)
multiplication_4 = Multiplication(A=desk_depth, B=vec_6.Vector)
line_2 = LineSDL(Start=cull_7, Direction=vrot_2, Length=number_slider_5)
multiplication_5 = Multiplication(A=desk_depth, B=vec_5.Vector)
rev = Reverse(Vector=multiplication_4)
rev_2 = Reverse(Vector=multiplication_5)
extr = Extrude(Base=line, Direction=multiplication_4)
extr_2 = Extrude(Base=line, Direction=rev)
extr_3 = Extrude(Base=line_2, Direction=multiplication_5)
extr_4 = Extrude(Base=line_2, Direction=rev_2)
brep = Brep([extr, extr_2])
brep_2 = Brep([extr_3, extr_4])
area_4 = Area(Geometry=brep)  # -> Area, Centroid
area_5 = Area(Geometry=brep_2)  # -> Area, Centroid
incurves_5 = PointInCurves(Point=simplify(area_4.Centroid), Curves=flatten(offset_4))  # -> Relationship, Index, Point
incurves_6 = PointInCurves(Point=simplify(area_5.Centroid), Curves=flatten(offset_6))  # -> Relationship, Index, Point
cull_8 = CullPattern(List=brep, CullPattern=incurves_5.Relationship)
cull_9 = CullPattern(List=brep_2, CullPattern=incurves_6.Relationship)
brep_3 = Brep([cull_9, cull_8])
area_6 = Area(Geometry=brep_3)  # -> Area, Centroid
incurves_7 = PointInCurves(Point=simplify(area_6.Centroid), Curves=flatten(crv_am_bnds))  # -> Relationship, Index, Point
cull_10 = CullPattern(List=brep_3, CullPattern=invert(incurves_7.Relationship))

# ---- group: AMENITY GENERATION / Sqf per ADSK employee (ws, am, circ)
data_10 = Data(division_2)

# ---- group: am crvs
crv_21 = Curve([crv_am_boundary_crvs, crv])

# ---- group: create mesh
cluster_5 = Cluster_2(crv=crv_21, crv_2=crv_3, data=Slider(1600, range=0..10000))

# ---- group: DESK_VECTOR_GEN
lng_3 = ListLength(List=extr_3)
vec_7 = Vector(multiplication_5)
lng_4 = ListLength(List=extr)
vec_8 = Vector(multiplication_4)
vec_9 = Vector(rev_2)
vec_10 = Vector(rev)
dup = DuplicateData(Data=vec_7, Number=lng_3, Order=True)
dup_2 = DuplicateData(Data=vec_9, Number=lng_3, Order=True)
dup_3 = DuplicateData(Data=vec_8, Number=lng_4, Order=True)
dup_4 = DuplicateData(Data=vec_10, Number=lng_4, Order=True)
vec_11 = Vector([dup, dup_2])
vec_12 = Vector([dup_3, dup_4])
cull_11 = CullPattern(List=vec_11, CullPattern=incurves_6.Relationship)
cull_12 = CullPattern(List=vec_12, CullPattern=incurves_5.Relationship)
area_7 = Area(Geometry=cull_9)  # -> Area, Centroid
area_8 = Area(Geometry=cull_8)  # -> Area, Centroid
line_3 = LineSDL(Start=area_7.Centroid, Direction=cull_11, Length=1)
line_4 = LineSDL(Start=area_8.Centroid, Direction=cull_12, Length=1)
vec_13 = Vector([cull_11, cull_12])
cull_13 = CullPattern(List=vec_13, CullPattern=invert(incurves_7.Relationship))

# ----
rev_3 = Reverse(Vector=cull_13)

crv_desktops = Curve(cull_10)
crv_n_bnds_2 = Curve(crv_neighborhood_bounds)
mesh_flrs = Mesh(cluster_5)
vec_desk_orientation = Vector(rev_3)

area_9 = Area(Geometry=crv_desktops)  # -> Area, Centroid
area_10 = Area(Geometry=crv_n_bnds_2)  # -> Area, Centroid
incurves_8 = PointInCurves(Point=simplify(area_9.Centroid), Curves=crv_n_bnds_2)  # -> Relationship, Index, Point
line_5 = LineSDL(Start=area_9.Centroid, Direction=vec_desk_orientation, Length=1)
sort_4 = SortList(Keys=incurves_8.Index)  # -> Keys, ValuesA
end_2 = EndPoints(Curve=line_5)  # -> Start, End
panel_14 = Panel(sort_4.Keys)
tag = TextTag3D(Location=area_10.Centroid, Size=Slider(5, range=0..10), Justification=5)
dots = DotDisplay(Point=end_2.Start, Colour=RGB(0, 0, 0), Size=Slider(0.2, range=0..1))

# ---- group: FLOOR_MESH_GEO
geo_3 = Geometry(mesh_flrs)
number_slider_7 = Slider(-200, range=-1000..1000)
area_11 = Area(Geometry=geo_3)  # -> Area, Centroid
end_3 = EndPoints(Curve=pipeline_6)  # -> Start, End
vec2pt = Vector2Pt(PointA=end_3.Start, PointB=end_3.End, Unitize=False)  # -> Vector, Length
pdecon_2 = Deconstruct(Point=area_11.Centroid)  # -> XComponent, YComponent, ZComponent
smaller = SmallerThan(FirstNumber=pdecon_2.XComponent, SecondNumber=number_slider_7)  # -> SmallerThan, OrEqualTo
dispatch_3 = Dispatch(List=geo_3, DispatchPattern=smaller.SmallerThan)  # -> ListA, ListB
move_3 = Move(Geometry=dispatch_3.ListA, Motion=vec2pt.Vector)  # -> Geometry, Transform
flr_2 = Geometry(dispatch_3.ListB)
flr_3 = Geometry(move_3.Geometry)

# ---- group: DESKTOPS
geo_4 = Geometry(crv_desktops)
area_12 = Area(Geometry=geo_4)  # -> Area, Centroid
pdecon_3 = Deconstruct(Point=area_12.Centroid)  # -> XComponent, YComponent, ZComponent
smaller_2 = SmallerThan(FirstNumber=pdecon_3.XComponent, SecondNumber=number_slider_7)  # -> SmallerThan, OrEqualTo
dispatch_4 = Dispatch(List=geo_4, DispatchPattern=smaller_2.SmallerThan)  # -> ListA, ListB
move_4 = Move(Geometry=dispatch_4.ListA, Motion=vec2pt.Vector)  # -> Geometry, Transform
flr_2_2 = Geometry(dispatch_4.ListB)
flr_3_2 = Geometry(move_4.Geometry)

# ---- group: AMENITY_BNDS
geo_5 = Geometry(crv_am_boundary_crvs)
area_13 = Area(Geometry=geo_5)  # -> Area, Centroid
pdecon_4 = Deconstruct(Point=area_13.Centroid)  # -> XComponent, YComponent, ZComponent
smaller_3 = SmallerThan(FirstNumber=pdecon_4.XComponent, SecondNumber=number_slider_7)  # -> SmallerThan, OrEqualTo
dispatch_5 = Dispatch(List=geo_5, DispatchPattern=smaller_3.SmallerThan)  # -> ListA, ListB
move_5 = Move(Geometry=dispatch_5.ListA, Motion=vec2pt.Vector)  # -> Geometry, Transform
flr_2_3 = Geometry(dispatch_5.ListB)
flr_3_3 = Geometry(move_5.Geometry)

# ---- group: N_BNDS
geo_6 = Geometry(crv_n_bnds_2)
area_14 = Area(Geometry=geo_6)  # -> Area, Centroid
pdecon_5 = Deconstruct(Point=area_14.Centroid)  # -> XComponent, YComponent, ZComponent
smaller_4 = SmallerThan(FirstNumber=pdecon_5.XComponent, SecondNumber=number_slider_7)  # -> SmallerThan, OrEqualTo
dispatch_6 = Dispatch(List=geo_6, DispatchPattern=smaller_4.SmallerThan)  # -> ListA, ListB
move_6 = Move(Geometry=dispatch_6.ListA, Motion=vec2pt.Vector)  # -> Geometry, Transform
flr_2_4 = Geometry(dispatch_6.ListB)
flr_3_4 = Geometry(move_6.Geometry)

# ---- group: DESK_ORIENTATION
dispatch_7 = Dispatch(List=vec_desk_orientation, DispatchPattern=smaller_2.SmallerThan)  # -> ListA, ListB
flr_2_5 = Geometry(dispatch_7.ListB)
flr_3_5 = Geometry(dispatch_7.ListA)

# ---- group: NEIGHBORHOOD_ID_VIS
area_15 = Area(Geometry=flr_2_4)  # -> Area, Centroid
area_16 = Area(Geometry=flr_3_4)  # -> Area, Centroid
split = SplitList(List=int_2, Index=num_f3)  # -> ListA, ListB
panel_15 = Panel(split.ListB)
panel_16 = Panel(split.ListA)
int_3 = Integer(panel_15)
int_4 = Integer(panel_16)
tag_2 = TextTag3D(Location=area_15.Centroid, Text=int_3, Size=Slider(5, range=0..10), Justification=5)
tag_3 = TextTag3D(Location=area_16.Centroid, Text=int_4, Size=Slider(5, range=0..10), Justification=5)

# ---- group: DESK_OBJECT_CHECK / DESK_ORIENTATION_VECTOR
merge_2 = Merge(Data1=flr_2_5, Data2=flr_3_5)

# ---- group: AMENITY GENERATION (continued)
crv_22 = Curve(graft(crv_15))
panel_17 = Panel(data_10)
multiplication_6 = Multiplication(A=data_10, B=Slider(0.52, range=0..1))

# ---- group: AMENITY GENERATION / Workspace Area
crv_23 = Curve(crv_22)

# ---- group: AMENITY GENERATION / Sqf per ADSK employee (ws, circ)
data_11 = Data(multiplication_6)

# ---- group: AMENITY GENERATION / Workspace Area
crv_24 = Curve(crv_23)

# ---- group: AMENITY GENERATION (continued)
area_17 = Area(Geometry=crv_23)  # -> Area, Centroid
panel_18 = Panel(data_11)
division_4 = Division(A=area_17.Area, B=data_11)
area_18 = Area(Geometry=crv_24)  # -> Area, Centroid
ma_2 = MassAddition(Input=flatten(area_18.Area))  # -> Result, PartialResults

# ---- group: AMENITY GENERATION / Num of ws per neighbourhood
data_12 = Data(division_4)

# ---- group: AMENITY GENERATION (continued)
python_3 = PythonScript(x=data_12)  # -> out, flatten(a); inputs x: list
# ---------- python_3: Python ----------
import math
a = []
for item in x:
    
    a.append(math.floor(item))
# ---------- end python_3 ----------
ma_3 = MassAddition(Input=python_3.a)  # -> Result, PartialResults
panel_19 = Panel(python_3.a)
tag_4 = TextTag3D(Location=flatten(crv_24), Text=python_3.a, Size=Slider(10, range=0..10), Justification=7)
tot_ws_available = Panel(ma_3.Result)

# ---- group: AMENITY GENERATION / Num of ws per neighbourhood
data_13 = Data(python_3.a)

# ---- group: AMENITY GENERATION / Total WS area
panel_20 = Panel(ma_2.Result)

# ---- group: AMENITY GENERATION / Num of ws per neighbourhood
data_14 = Data(data_13)

# ---- group: DESK_OBJECT_CHECK
area_19 = Area(Geometry=flr_3_2)  # -> Area, Centroid
area_20 = Area(Geometry=flr_2_2)  # -> Area, Centroid
panel_21 = Panel(area_20.Centroid)
panel_22 = Panel(area_19.Centroid)
incurves_9 = PointInCurves(Point=simplify(area_19.Centroid), Curves=flr_3_4)  # -> Relationship, Index, Point
incurves_10 = PointInCurves(Point=simplify(area_20.Centroid), Curves=flr_2_4)  # -> Relationship, Index, Point
addition_3 = Addition(A=incurves_10.Index, B="8")
addition_4 = Addition(A=incurves_9.Index, B="0")
sort_5 = SortList(Keys=addition_4)  # -> Keys, ValuesA
sort_6 = SortList(Keys=addition_3)  # -> Keys, ValuesA
panel_23 = Panel(sort_6.Keys)
panel_24 = Panel(sort_5.Keys)
panel_25 = Panel(merge_2)

# ---- group: DESK_VECTOR_VIS
line_6 = LineSDL(Start=area_19.Centroid, Direction=flr_3_5, Length=1)
line_7 = LineSDL(Start=area_20.Centroid, Direction=flr_2_5, Length=1)
end_4 = EndPoints(Curve=line_6)  # -> Start, End
end_5 = EndPoints(Curve=line_7)  # -> Start, End
dots_2 = DotDisplay(Point=end_4.Start, Colour=RGB(0, 0, 0), Size=Slider(0.2, range=0..1))
dots_3 = DotDisplay(Point=end_5.Start, Colour=RGB(0, 0, 0), Size=Slider(0.2, range=0..1))

# ---- group: DESK_OBJECT_CHECK / DESK_CENTER_PT
merge_3 = Merge(Data1=area_20.Centroid, Data2=area_19.Centroid)

# ---- group: DESK_OBJECT_CHECK / DESK_N_ID
merge_4 = Merge(Data1=addition_3, Data2=addition_4)

# ---- group: DESK_OBJECT_CHECK (continued)
panel_26 = Panel(merge_4)
panel_27 = Panel(merge_3)
item_16 = ListItem(List=merge_3, Index=Slider(144, range=0..300), Wrap=True)
dots_4 = DotDisplay(Point=item_16, Colour=RGB(0, 0, 0), Size=1)

# ----
# OUTPUTS
data_desk_center_points = Data(merge_3)
data_desk_orientation = Data(merge_2)
data_desk_neighborhood_id = Data(merge_4)
mesh_floor_2 = Mesh(flr_2)
mesh_floor_3 = Mesh(flr_3)
crv_amenity_polylines = Curve([flr_2_3, flr_3_3])

# ==== cluster Cluster
bool = ClusterInput()
L = ClusterInput()
L_2 = ClusterInput()
bool_2 = Boolean(bool)
dispatch = Dispatch(List=L, DispatchPattern=bool_2)  # -> ListA, ListB
dispatch_2 = Dispatch(List=L_2, DispatchPattern=bool_2)  # -> ListA, ListB
data = Data(flatten([dispatch_2.ListA, dispatch.ListB]))
data_2 = ClusterOutput(data)

# ==== cluster Cluster_2
crv = ClusterInput()
crv_2 = ClusterInput()
crv_3 = Curve(crv)
crv_4 = Curve(crv_2)
boundary = BoundarySurfaces(Edges=crv_4)
data = ClusterInput()
rdiff = RegionDifference(CurvesA=boundary, CurvesB=crv_3)
data_2 = Data(data)
boundary_2 = BoundarySurfaces(Edges=rdiff)
custom_mesh_settings = SettingsCustom(
    StitchSeams=True,
    SimplePlanes=False,
    Refine=True,
    MinCount=data_2,
    MaxCount=400,
    AspectRatio=20,
    MaxDistance=0,
    MaxAngle=20,
    MinEdge=0,
    MaxEdge=0)
mesh = MeshBrep(Brep=boundary_2, Settings=custom_mesh_settings)
M = ClusterOutput(mesh)
