# Grasshopper definition m-03.gh (Grasshopper 0.9.76)
# plug-ins: Python Interpreter

pipeline = GeometryPipeline(
    GroupByLayer=False,
    GroupByType=False,
    IncludeHidden=True,
    IncludeLocked=True,
    LayerFilter="mesh",
    NameFilter="*",
    TypeFilter=32)
pipeline_2 = GeometryPipeline(
    GroupByLayer=False,
    GroupByType=False,
    IncludeHidden=True,
    IncludeLocked=True,
    LayerFilter="circulation",
    NameFilter="*",
    TypeFilter=4)
file_path = FilePath("C:\Users\danil\Documents\GitHub\gda\dummy data\d-07 desk center points.pkl")
file_path_2 = FilePath("C:\Users\danil\Documents\GitHub\gda\dummy data\d-12_Amenity_Location.pkl")
python = PythonScript(x=pipeline_2)  # -> out, a; inputs x: list
# ---------- python: Python ----------
import rhinoscriptsyntax as rs
import pickle

circ_pts = []

for pl in x:
    poly = rs.coercecurve(pl)
    pts = rs.CurvePoints(poly)
    
    new_pts = []
    
    for pt in pts:
        new_pts.append([pt.X, pt.Y, pt.Z])
    
    circ_pts.append(new_pts)

a = pickle.dumps(circ_pts)
# ---------- end python ----------
python_2 = PythonScript(x=file_path)  # -> out, a, b
# ---------- python_2: Python ----------
import pickle
import rhinoscriptsyntax as rs

data = pickle.load( open(x, 'rb') )

dp = []

for d in data:
    dp.append([d["coords"], d["neighbourhood"]])

a = pickle.dumps(dp)

b = [rs.AddPoint(x[0]) for x in dp]

#print data[0]
# ---------- end python_2 ----------
mjoin = MeshJoin(Meshes=pipeline)
demesh = DeconstructMesh(Mesh=mjoin)  # -> Vertices, Faces, Colours, Normals
deface = DeconstructFace(Face=demesh.Faces)  # -> CornerA, CornerB, CornerC, CornerD
python_3 = PythonScript(a=deface.CornerA, b=deface.CornerB, c=deface.CornerC, d=deface.CornerD)  # -> out, nl; inputs a: list, b: list, c: list, d: list
# ---------- python_3: Python ----------
import pickle

nodeLists = []

for i, i_a in enumerate(a):
    i_b = b[i]
    i_c = c[i]
    i_d = d[i]
    
    nodeLists.append(list(set([i_a, b[i], c[i], d[i]])))

nl = pickle.dumps(nodeLists)
# ---------- end python_3 ----------
make_graph = PythonScript(nodes=demesh.Vertices, nl=python_3.nl, cp=python.a, dp=python_2.a, ap=file_path_2)  # -> out, g, n_out, lines_out; inputs nodes: list
# ---------- make_graph: Python ----------
import rhinoscriptsyntax as rs
import math
import pickle

def dist(pt1, pt2):
    return math.sqrt((pt1[0] - pt2[0])**2 + (pt1[1] - pt2[1])**2 + (pt1[2] - pt2[2])**2)

edgeLists = pickle.loads(nl)
circ_pts = pickle.loads(cp)
desk_pts = pickle.loads(dp)

with open(ap, 'rb') as f:
    am_pts = pickle.load(f)

graph = {}
graph["nodes"] = []
graph["edges"] = {}

for node in nodes:
    pt = rs.coerce3dpoint(node)
    graph["nodes"].append({"coords": [pt.X, pt.Y, pt.Z]})

for i in range(len(edgeLists)):
    ptSet = edgeLists[i]
    
    for j, index in enumerate(ptSet):
        
        prevIndex = ptSet[j-1]
        diagIndex = ptSet[j-2]
        
        if index not in graph["edges"].keys():
            graph["edges"][index] = {}
        if prevIndex not in graph["edges"].keys():
            graph["edges"][prevIndex] = {}
        
        dist_edge = dist(graph["nodes"][index]["coords"], graph["nodes"][prevIndex]["coords"])
        
        if prevIndex not in graph["edges"][index]:
            graph["edges"][index][prevIndex] = dist_edge
        if index not in graph["edges"][prevIndex]:
            graph["edges"][prevIndex][index] = dist_edge
        
        if len(ptSet) == 4:
            if diagIndex not in graph["edges"].keys():
                graph["edges"][diagIndex] = {}
            dist_diag = dist(graph["nodes"][index]["coords"], graph["nodes"][diagIndex]["coords"])
            if diagIndex not in graph["edges"][index]:
                graph["edges"][index][diagIndex] = dist_diag

### ADD CIRCULATION

for route in circ_pts:
    
    # find closest node to circ start
    minDist = float("inf")
    indx = 0
    for i, node in enumerate(graph["nodes"]):
        d = dist(route[0], node["coords"])
        if d < minDist:
            minDist = d
            indx = i
    
    # add connection to node
    graph["edges"][indx][len(graph["nodes"])] = minDist
    graph["edges"][len(graph["nodes"])] = {}
    graph["edges"][len(graph["nodes"])][indx] = minDist
    graph["nodes"].append({"coords": route[0]})
    
    #connect each pt in route
    for j, pt in enumerate(route[1:]):
        d = dist(route[j-1], pt)
        graph["edges"][len(graph["nodes"])-1][len(graph["nodes"])] = d
        graph["edges"][len(graph["nodes"])] = {}
        graph["edges"][len(graph["nodes"])][len(graph["nodes"])-1] = d
        graph["nodes"].append({"coords": pt})
    
    #find closest node to circ end
    minDist = float("inf")
    indx = 0
    for i, node in enumerate(graph["nodes"][:-1]):
        d = dist(route[-1], node["coords"])
        if d < minDist:
            minDist = d
            indx = i
    
    # add connection to node
    graph["edges"][indx][len(graph["nodes"])-1] = minDist
    graph["edges"][len(graph["nodes"])-1][indx] = minDist


### ADD DESKS

n_data = []

for j, desk in enumerate(desk_pts):
    
    n_data.append([desk[1], len(graph["nodes"])])
    
    # find closest node to desk
    minDist = float("inf")
    indx = 0
    for i, node in enumerate(graph["nodes"]):
        d = dist(desk[0], node["coords"])
        if d < minDist:
            minDist = d
            indx = i
    
    # add connection to node
    graph["edges"][indx][len(graph["nodes"])] = minDist
    graph["edges"][len(graph["nodes"])] = {}
    graph["edges"][len(graph["nodes"])][indx] = minDist
    graph["nodes"].append({"coords": desk[0]})


### ADD AMENITIES

a_data = {}

for j, amenity in enumerate(am_pts.keys()):
    
    a_data[amenity] = []
    
    for k, coords in enumerate(am_pts[amenity]):
        
        print coords
        
        a_data[amenity].append(len(graph["nodes"]))
        
        # find closest node to desk
        minDist = float("inf")
        indx = 0
        for i, node in enumerate(graph["nodes"]):
            d = dist(coords, node["coords"])
            if d < minDist:
                minDist = d
                indx = i
        
        # add connection to node
        graph["edges"][indx][len(graph["nodes"])] = minDist
        graph["edges"][len(graph["nodes"])] = {}
        graph["edges"][len(graph["nodes"])][indx] = minDist
        graph["nodes"].append({"coords": coords})

g = pickle.dumps(graph)


### GENERATE d-09

neighb_data = {}

for n in n_data:
    if n[0] not in neighb_data.keys():
        neighb_data[n[0]] = []
    neighb_data[n[0]].append(n[1])

assign_data = { "neighborhoods" : neighb_data, "amenities" : a_data }

n_out = pickle.dumps(assign_data)

print assign_data

### LINES PREVIEW

#lines_out = []
#
#for key in graph["edges"].keys():
#    for pair in graph["edges"][key].keys():
#        l = rs.AddLine(graph["nodes"][key]["coords"], graph["nodes"][pair]["coords"])
#        lines_out.append(l)
# ---------- end make_graph ----------
write_data = PythonScript(path="C:\Users\danil\Documents\GitHub\gda\dummy data\", g=make_graph.g, n=make_graph.n_out)  # -> out
# ---------- write_data: Python ----------
import pickle

n_data = pickle.loads(n)
g_data = pickle.loads(g)

print n_data

with open(path+"d-09 graph assignment data.pkl", 'wb') as f:  
    pickle.dump(n_data, f, pickle.HIGHEST_PROTOCOL)

with open(path+"d-10 graph data.pkl", 'wb') as f:  
    pickle.dump(g_data, f, pickle.HIGHEST_PROTOCOL)
# ---------- end write_data ----------
