# Grasshopper definition m-04.gh (Grasshopper 0.9.76)
# plug-ins: Python Interpreter

_2nd_floor_teams = Panel("""Gordon Kurtenbach
Azam Khan
Thomas White
Ramtin Attar
Ryan Schmidt
George Fitzmaurice
Francesco Iorio
John King
Michael Stamler
Sales Team
Greg Boone
Michael Wilms
Jon Steinberg
Tim Fowler
Marc Ouellette
Laurence Cymet
Yvonne Yeung
Tim Wong
Duncan Brinsmead
Ian Ameline
Jason Walter
Karen Tam
Gordon Bradley
Gareth Pennington
Kevin Li
Dan Whiteley""")
file_path = FilePath("C:\Users\james\Documents\GitHub\gda\dummy data\d-09 neighborhood data.pkl")

# ---- group: d-03
file_path_2 = FilePath("C:\Users\james\Documents\GitHub\gda\DATA\-team_data.json")

# ----
python = PythonScript()  # -> path
# ---------- python: Python ----------
import pickle

path = ghenv.LocalScope.ghdoc.Path
path = path.split("\\")
path = "\\".join(path[:-3]) + "\\python resources"
# ---------- end python ----------

# ---- group: d-09["neighborhoods"]
python_2 = PythonScript(x=file_path)  # -> a
# ---------- python_2: Python ----------
import pickle

data = pickle.load( open(x, 'rb') )

a = pickle.dumps(data["neighborhoods"])
# ---------- end python_2 ----------

# ---- group: d-03 {"team" : size+interns}
python_3 = PythonScript(x=file_path_2)  # -> a
# ---------- python_3: Python ----------
import pickle
import json

data = json.load( open(x, 'rb') )

a = pickle.dumps({k:data[k]["size"]+data[k]["interns"] for k in data.keys()} )
# ---------- end python_3 ----------

# ----
_3rd_floor_teams = Panel("""Joseph Doyle
Severin Wille
Dan Pressman
Mark Davies
Sriram Dayanand
Ken Wong
Mathieu Lesage
Thomas Heermann
Barbara Ott
Vivian Fong
Bing Lin
Mike Hogeboom
Monika Burman
Daniela Stajic
Kem-Laurin Kramer
Martin De Lasa
Lap Ho
Wayne Arnold
John Schrag
Moncef Mestiri
Kristin Dalzell
Dale Glandfield""")

# ---- group: dummy d-09
python_4 = PythonScript()  # -> out, a
# ---------- python_4: Python ----------
import pickle

from random import randint

n_count = 15
nodes = 30000

data = {str(n):[] for n in range(n_count)}
placed = []

for n in data.keys():
    for i in range(randint(15,250)):
        d = randint(0,nodes)
        while d in placed:
            d += 1
        data[n].append(d)

a = pickle.dumps(data)
# ---------- end python_4 ----------

# ----
merge = Merge(Data1=_3rd_floor_teams, Data2=_2nd_floor_teams)

# ---- group: Team Placement Order
data = Data(merge)

# ----
python_5 = PythonScript(x=data)  # -> a; inputs x: list
# ---------- python_5: Python ----------
import pickle

a = pickle.dumps(x)
# ---------- end python_5 ----------

# ---- group: m-04
python_6 = PythonScript(resource_path=python, t_data=python_3, n_data=python_4.a, t_target=python_5)  # -> out, err, a
# ---------- python_6: Python ----------
import pickle
import json

#load input data with pickle
n_desks = pickle.loads(n_data)
team_size = pickle.loads(t_data)
team_order = pickle.loads(t_target)

sz = [team_size[i] for i in team_size.keys()]
s = 0
for t in sz:
    s+=t
print s

#count of neighborhoods in input
n_count = len( n_desks.keys() )

#output data container
data = {team:[] for team in team_size.keys()}

#tally of team members placed (per team)
placed = {k:0 for k in team_size.keys()}
#tally of claimed seats (all start at 0)
claimed = [0 for i in range(n_count)]
#tally available seats
available = [ len(n_desks[ str(i) ] ) for i in range(n_count)]

#check to make sure datasets match up
for t in team_order:
    if t not in team_size:
        print "%s not found in dataset" %(t)
for t in team_size.keys():
    if t not in team_order:
        print "%s not found in placement" %(t)



#place whole teams sequentially
for i in range(n_count):
    for team in team_order:
        #check if team has been fully placed
        if placed[team] == 0:
            #check if there is space available
            if team_size[team] <= available[i]:
                for k in range( team_size[team] ):
                    data[team].append( n_desks[str(i)][claimed[i]] )
                    placed[team] += 1
                    claimed[i] += 1
                available[i] -= team_size[team]

#place partial teams in remaining desks
for i in range(n_count):
    if available[i] > 0:
        for team in team_order:
            if placed[team] < team_size[team]:
                #print "n%d has %d seats available" %(i+1, available[i])
                for p in range( available[i]):
                    if( placed[team] == team_size[team] ):
                        break
                    data[team].append( n_desks[str(i)][claimed[i]] )
                    placed[team] = placed[team] + 1
                    available[i] = available[i] - 1
                    claimed[i] = claimed[i] + 1

#check for unplaced team
err = 0
for team in team_size:
    if placed[team] != team_size[team]:
        err += team_size[team]-placed[team]
        print "%d of %s's team weren't placed" %(team_size[team]-placed[team], team)

#output with pickle
a = pickle.dumps(data)
# ---------- end python_6 ----------

# ---- group: ERROR: People without Desks
int = Integer(python_6.err)

# ---- group: d-11
data_2 = Data(python_6.a)

# ----
panel = Panel(int)
