# Grasshopper definition m-05.gh (Grasshopper 0.9.76)
# plug-ins: Python Interpreter, LunchBox

# ---- group: DUMMY DATA
rec = Rectangle({Plane=PlaneXY(6.0571875, 0, 0), Size=Domain2(u=0..96.43594005, v=0..273.4593828)})
random = Random(Range="0 to Pi*2", Number="15", Seed=2)
pop2d = Populate2D(Region=rec, Count="15", Seed=1)
randomsplit = RandomSplitList(MasterList=pop2d, Seed=2, Split=Slider(0.4, range=0..1))  # -> ListA, ListB
Z = UnitZ(Factor="15")
move = Move(Geometry=randomsplit.ListB, Motion=Z)  # -> Geometry, Transform
merge = Merge(Data1=randomsplit.ListA, Data2=move.Geometry)
prot = RotatePlane(Plane=merge, Angle=random)
random_2 = Random(Range="15/2 to 50/2", Number="15", Seed=2)
neg = Negative(Value=random_2)
dom = ConstructDomain(DomainStart=neg, DomainEnd=random_2)
rectangle = Rectangle(Plane=prot, XSize=dom, YSize="-15/2 to 15/2", Radius=0)  # -> Rectangle, Length

# ---- group: EXTRACT TXT & POSITION FROM RH DOC
panel = Panel("fixed_am")  # disabled
reset = Button()  # disabled
python = PythonScript(layerName=panel, reset=reset)  # -> out, text_contents, text_location, num; disabled
# ---------- python: Python ----------
import rhinoscriptsyntax as rs
import scriptcontext as sc
import Rhino

import json

rDoc = Rhino.RhinoDoc.ActiveDoc
sc.doc = rDoc

guids = []
text_location = []
text_contents = []


try:
    guids.extend(rs.ObjectsByLayer(layerName))
except:
    print layer + " doesn't exist"

for item in guids:
    text_contents.append( rs.TextObjectText(item) )
    text_location.append( rs.TextObjectPoint(item) )

sc.doc = ghdoc
# ---------- end python ----------

# ---- group: Amenities from Final Design
_2nd_floor_amenities = Panel("""Library
SCRUM
Ad-Hoc
Ad-Hoc
S Meeting
CTO Sandbox
Recording Room
M Meeting
Social Hub
Kitchenette
Storage
IDF
EIS Shop
XL Meeting
Wellness
Reception
Gallery
Coat Closet
S Meeting
VR/AR Lab
Copy/Print/Mail
Storage
Telepresence
Shower
Sports Equipment Room
SCRUM
S Meeting
Phone Booth
Phone Booth
Ad-Hoc
Phone Booth
SCRUM""")
_3rd_floor_amenities = Panel("""Lab
Hazmat
Model Scanning Room
NDA
SCRUM
Ad-Hoc
S Meeting
S Meeting
Phone Booth
Phone Booth
Storage
Copy/Print/Mail
User Experience Viewing Room
SCRUM
Phone Booth
M Meeting
Equipment Lab
Server
S Meeting
SCRUM
Games Room
Kitchenette
M Meeting
Ad-Hoc
L Meeting
Ad-Hoc
Ad-Hoc
Phone Booth
SCRUM
Phone Booth
Ad-Hoc""")
merge_2 = Merge(Data1=_3rd_floor_amenities, Data2=_2nd_floor_amenities)

# ---- group: Fixed Amenities from Final Design / FIXED AMENITY TITLES
data = Data(["NDA", "Kitchenette", "Games Room", "Kitchenette", "Social Hub", "Reception", "Storage", "Copy/Print/Mail", "VR/AR Lab", "Copy/Print/Mail", "Storage", "Telepresence", "Shower", "Sports Equipment Room", "Model Scanning Room", "Hazmat", "Lab", "Viz Studio", "Cafe", "CTO Sandbox", "Recording Room", "Storage", "Mechanical", "Mechanical", "IDF", "Equipment Lab", "Server", "EIS Shop", "Wellness", "User Experience Viewing Room", "Library", "Coat Closet", "Coat Closet"])

# ---- group: Fixed Amenities from Final Design / FIXED AMENITY XYZ
data_2 = Data([Point(97.20008818, 37.26202138, 0), Point(88.12216168, 187.544584, 15), Point(85.0360444, 172.213714, 15), Point(84.21116391, 159.7073915, 0), Point(83.92385121, 170.2765707, 0), Point(48.81137826, 110.3108274, 0)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])

# ----
python_2 = PythonScript()  # -> path
# ---------- python_2: Python ----------
import pickle

path = ghenv.LocalScope.ghdoc.Path
path = path.split("\\")
path = "\\".join(path[:-3]) + "\\python resources"
# ---------- end python_2 ----------

# ---- group: d-04
file_path = FilePath("C:\Users\james\Documents\GitHub\gda\DATA\-amenity_data.json")

# ---- group: Fixed Amenities from Final Design
panel_2 = Panel(data_2)
panel_3 = Panel(data)

# ---- group: d-04
python_3 = PythonScript(x=file_path)  # -> a
# ---------- python_3: Python ----------
import pickle
import json

data = json.load( open(x, 'rb') )

a = pickle.dumps( data )
# ---------- end python_3 ----------

# ---- group: Fixed Amenities { "name" : [x,y,z], ... }
python_4 = PythonScript(a_name=data, a_pos=data_2)  # -> out, a; inputs a_name: list, a_pos: list of Point3d
# ---------- python_4: Python ----------
import pickle

data = {amen:[] for amen in a_name}

for i, name in enumerate(a_name):
    pos = [a_pos[i].X, a_pos[i].Y, a_pos[i].Z]
    data[name].append(pos)

a = pickle.dumps(data)
# ---------- end python_4 ----------

# ---- group: Amenities ["name", ...]
python_5 = PythonScript(x=merge_2)  # -> a; inputs x: list
# ---------- python_5: Python ----------
import pickle

a = pickle.dumps(x)
# ---------- end python_5 ----------

# ----
crv = Curve(rectangle.Rectangle)

# ---- group: Unfixed amenities, sorted by size ["name", "name", ...]
python_6 = PythonScript(a_list=python_3, a_final=python_5)  # -> out, a
# ---------- python_6: Python ----------
import pickle

am_ref = pickle.loads(a_list)
amenities = pickle.loads(a_final)

data = []
sizes = []

for am in amenities:
    if not am_ref[am]["fixed"]:
        data.append(am)
        sizes.append( am_ref[am]["size"] )

data = [data for (sizes,data) in sorted(zip(sizes,data), reverse=True)]

a = pickle.dumps(data)
# ---------- end python_6 ----------

# ----
python_7 = PythonScript(resource_path=python_2, am_crv=crv, a_data=python_3, a_unfixed=python_6.a, a_fixed=python_4.a)  # -> out, err, a; inputs am_crv: list of Curve
# ---------- python_7: Python ----------
import pickle
import json
from math import floor

import rhinoscriptsyntax as rs

#load input data with pickle
a_ref = pickle.loads(a_data)
a_unfix = pickle.loads(a_unfixed)
a_fix = pickle.loads(a_fixed)

#size dictionary for amenities
a_sizes = {k:a_ref[k]["size"] for k in a_ref.keys()}

#output data container
data = {am:[] for am in a_ref.keys()}
err = 0

#tally of amenities assigned and occupied area in each polyline
#[0]: count (int)
#[1]: occupied area (float)
a_occup = [ [0,0] for crv in am_crv ]

#extract area and centroid for each amenity polyline
#[ [area(float), cp(point)], ...]
a_occup = [ [0,0] for crv in am_crv ]
a_area = [ rs.CurveArea(crv)[0] for crv in am_crv ]
a_cp = [ rs.CurveAreaCentroid(crv)[0] for crv in am_crv ]
a_vec = []
#calculate primary direction of area
#average of direction of two longest edges
for i, crv in enumerate(am_crv):
    edges = rs.ExplodeCurves(crv)
    lengths = [rs.CurveLength(edge) for edge in edges]
    #sort edges by length
    edges = [x for (y,x) in sorted(zip(lengths, edges), reverse=True)]
    #extract tangent vectors from two longest edges
    vecs = [rs.CurveTangent(edges[i],rs.CurveParameter(edges[i],0.5))for i in range(2)]
    #calculate average vector (v_avg = (v1 + v2) * 0.5
    avg = rs.VectorScale( rs.VectorAdd(vecs[0],vecs[1] ), 0.5 )
    #check if vectors cancel, and flip if needed
    if(rs.VectorLength(avg) < 0.001):
        avg = rs.VectorScale( rs.VectorAdd( rs.VectorReverse(vecs[0]),vecs[1] ), 0.5 )
    #add to amenity curve data
    a_vec.append(rs.VectorUnitize(avg))

for am in a_unfix:
    big = a_area.index(max(a_area))
    if (a_area[big]-a_occup[big][1]) > a_ref[am]:
        #extract point for amenity "door"
        dir = 1
        if( a_occup[big][0]%2 > 0):
           dir *= -1
        pt = rs.VectorAdd(a_cp[big],rs.VectorScale(a_vec[big], 5*dir*floor(a_occup[big][0]/2)))
        data[am].append( [pt.X, pt.Y, pt.Z] )
        
        #update tallies
        a_occup[big][0] += 1
        a_occup[big]
    else:
        err += a_ref[am]

#add fixed amenity locations
data.update(a_fix)

#output with pickle
a = pickle.dumps(data)
# ---------- end python_7 ----------

# ---- group: ERROR: Unplaced Amenity Area (sf)
int = Integer(python_7.err)

# ---- group: d-12 {"amenity":[x,y,z],...}
data_3 = Data(python_7.a)

# ----
panel_4 = Panel(int)
