# Grasshopper definition makeGraph.gh (Grasshopper 0.9.76)
# plug-ins: Python Interpreter, HDTReference

pipeline = GeometryPipeline(
    GroupByLayer=False,
    GroupByType=False,
    IncludeHidden=True,
    IncludeLocked=True,
    LayerFilter="mesh_low",
    NameFilter="*",
    TypeFilter=32)
pipeline_2 = GeometryPipeline(
    GroupByLayer=False,
    GroupByType=False,
    IncludeHidden=True,
    IncludeLocked=True,
    LayerFilter="circulation",
    NameFilter="*",
    TypeFilter=4)
pipeline_3 = GeometryPipeline(
    GroupByLayer=False,
    GroupByType=False,
    IncludeHidden=True,
    IncludeLocked=True,
    LayerFilter="amenities",
    NameFilter="*",
    TypeFilter=4)
file_path = FilePath("C:\Users\danil\Documents\GitHub\gda\dummy data\d-07 desk center points.pkl")
file_path_2 = FilePath("C:\Users\danil\Documents\GitHub\gda\dummy data\d-12 amenity assignment data.pkl")
python = PythonScript()  # -> out, a
# ---------- python: Python ----------
minDist = [[float('inf')] * 2] * 2

print minDist
# ---------- end python ----------
area = Area(Geometry=pipeline_3)  # -> Area, Centroid
python_2 = PythonScript(x=pipeline_2)  # -> out, a; inputs x: list
# ---------- python_2: Python ----------
import rhinoscriptsyntax as rs
import pickle

circ_pts = []

for pl in x:
    poly = rs.coercecurve(pl)
    pts = rs.CurvePoints(poly)
    
    new_pts = []
    
    for pt in pts:
        new_pts.append([pt.X, pt.Y, pt.Z])
    
    circ_pts.append(new_pts)

a = pickle.dumps(circ_pts)
# ---------- end python_2 ----------
python_3 = PythonScript(x=file_path)  # -> out, a, b
# ---------- python_3: Python ----------
import pickle
import rhinoscriptsyntax as rs

data = pickle.load( open(x, 'rb') )

dp = []

for d in data:
    dp.append([d["coords"], d["neighbourhood"]])

a = pickle.dumps(dp)

b = [rs.AddPoint(x[0]) for x in dp]

#print data[0]
# ---------- end python_3 ----------
mjoin = MeshJoin(Meshes=pipeline)
panel = Panel(area.Centroid)
demesh = DeconstructMesh(Mesh=mjoin)  # -> Vertices, Faces, Colours, Normals
deface = DeconstructFace(Face=demesh.Faces)  # -> CornerA, CornerB, CornerC, CornerD
pipeline_4 = GeometryPipeline(
    GroupByLayer=False,
    GroupByType=False,
    IncludeHidden=True,
    IncludeLocked=True,
    LayerFilter="start",
    NameFilter="*",
    TypeFilter=1)
pipeline_5 = GeometryPipeline(
    GroupByLayer=False,
    GroupByType=False,
    IncludeHidden=True,
    IncludeLocked=True,
    LayerFilter="end",
    NameFilter="*",
    TypeFilter=1)
python_4 = PythonScript(a=deface.CornerA, b=deface.CornerB, c=deface.CornerC, d=deface.CornerD)  # -> out, nl; inputs a: list, b: list, c: list, d: list
# ---------- python_4: Python ----------
import pickle

nodeLists = []

for i, i_a in enumerate(a):
    i_b = b[i]
    i_c = c[i]
    i_d = d[i]
    
    nodeLists.append(list(set([i_a, b[i], c[i], d[i]])))

nl = pickle.dumps(nodeLists)
# ---------- end python_4 ----------
cp = ClosestPoint(Point=pipeline_4, Cloud=demesh.Vertices)  # -> ClosestPoint, CPIndex, Distance
cp_2 = ClosestPoint(Point=pipeline_5, Cloud=demesh.Vertices)  # -> ClosestPoint, CPIndex, Distance
make_graph = PythonScript(nodes=demesh.Vertices, nl=python_4.nl, cp=python_2.a, dp=python_3.a, ap=file_path_2)  # -> out, g, n_out, lines_out; inputs nodes: list
# ---------- make_graph: Python ----------
import rhinoscriptsyntax as rs
import math
import pickle

def dist(pt1, pt2):
    return math.sqrt((pt1[0] - pt2[0])**2 + (pt1[1] - pt2[1])**2 + (pt1[2] - pt2[2])**2)

edgeLists = pickle.loads(nl)
circ_pts = pickle.loads(cp)
desk_pts = pickle.loads(dp)

with open(ap, 'rb') as f:
    am_pts = pickle.load(f)

graph = {}
graph["nodes"] = []
graph["edges"] = {}

for node in nodes:
    pt = rs.coerce3dpoint(node)
    graph["nodes"].append({"coords": [pt.X, pt.Y, pt.Z]})

for i in range(len(edgeLists)):
    ptSet = edgeLists[i]
    
    for j, index in enumerate(ptSet):
        
        prevIndex = ptSet[j-1]
        diagIndex = ptSet[j-2]
        
        if index not in graph["edges"].keys():
            graph["edges"][index] = {}
        if prevIndex not in graph["edges"].keys():
            graph["edges"][prevIndex] = {}
        
        dist_edge = dist(graph["nodes"][index]["coords"], graph["nodes"][prevIndex]["coords"])
        
        if prevIndex not in graph["edges"][index]:
            graph["edges"][index][prevIndex] = dist_edge
        if index not in graph["edges"][prevIndex]:
            graph["edges"][prevIndex][index] = dist_edge
        
        if len(ptSet) == 4:
            if diagIndex not in graph["edges"].keys():
                graph["edges"][diagIndex] = {}
            dist_diag = dist(graph["nodes"][index]["coords"], graph["nodes"][diagIndex]["coords"])
            if diagIndex not in graph["edges"][index]:
                graph["edges"][index][diagIndex] = dist_diag

### ADD CIRCULATION

for route in circ_pts:
    
    # find closest node to circ start
    minDist = float("inf")
    indx = 0
    for i, node in enumerate(graph["nodes"]):
        d = dist(route[0], node["coords"])
        if d < minDist:
            minDist = d
            indx = i
    
    # add connection to node
    graph["edges"][indx][len(graph["nodes"])] = minDist
    graph["edges"][len(graph["nodes"])] = {}
    graph["edges"][len(graph["nodes"])][indx] = minDist
    graph["nodes"].append({"coords": route[0]})
    
    #connect each pt in route
    for j, pt in enumerate(route[1:]):
        d = dist(route[j-1], pt)
        graph["edges"][len(graph["nodes"])-1][len(graph["nodes"])] = d
        graph["edges"][len(graph["nodes"])] = {}
        graph["edges"][len(graph["nodes"])][len(graph["nodes"])-1] = d
        graph["nodes"].append({"coords": pt})
    
    #find closest node to circ end
    minDist = float("inf")
    indx = 0
    for i, node in enumerate(graph["nodes"][:-1]):
        d = dist(route[-1], node["coords"])
        if d < minDist:
            minDist = d
            indx = i
    
    # add connection to node
    graph["edges"][indx][len(graph["nodes"])-1] = minDist
    graph["edges"][len(graph["nodes"])-1][indx] = minDist


### ADD DESKS

n_data = []

for j, desk in enumerate(desk_pts):
    
    n_data.append([desk[1], len(graph["nodes"])])
    
    # find closest node to desk
    minDist = float("inf")
    indx = 0
    for i, node in enumerate(graph["nodes"]):
        d = dist(desk[0], node["coords"])
        if d < minDist:
            minDist = d
            indx = i
    
    # add connection to node
    graph["edges"][indx][len(graph["nodes"])] = minDist
    graph["edges"][len(graph["nodes"])] = {}
    graph["edges"][len(graph["nodes"])][indx] = minDist
    graph["nodes"].append({"coords": desk[0]})


### ADD AMENITIES

a_data = {}

for j, amenity in enumerate(am_pts.keys()):
    
    a_data[amenity] = []
    
    for k, coords in enumerate(am_pts[amenity]):
        
        print coords
        
        a_data[amenity].append(len(graph["nodes"]))
        
        # find closest node to desk
        minDist = float("inf")
        indx = 0
        for i, node in enumerate(graph["nodes"]):
            d = dist(coords, node["coords"])
            if d < minDist:
                minDist = d
                indx = i
        
        # add connection to node
        graph["edges"][indx][len(graph["nodes"])] = minDist
        graph["edges"][len(graph["nodes"])] = {}
        graph["edges"][len(graph["nodes"])][indx] = minDist
        graph["nodes"].append({"coords": coords})

g = pickle.dumps(graph)


### GENERATE d-09

neighb_data = {}

for n in n_data:
    if n[0] not in neighb_data.keys():
        neighb_data[n[0]] = []
    neighb_data[n[0]].append(n[1])

assign_data = { "neighborhoods" : neighb_data, "amenities" : a_data }

n_out = pickle.dumps(assign_data)

print assign_data

### LINES PREVIEW

lines_out = []

for key in graph["edges"].keys():
    for pair in graph["edges"][key].keys():
        l = rs.AddLine(graph["nodes"][key]["coords"], graph["nodes"][pair]["coords"])
        lines_out.append(l)
# ---------- end make_graph ----------
panel_2 = Panel("C:\Users\danil\Documents\GitHub\gda\dummy data\")
geo = Geometry(make_graph.lines_out)
dijkstra = PythonScript(g=make_graph.g, start=cp.CPIndex, end=cp_2.CPIndex)  # -> out, a
# ---------- dijkstra: Python ----------
from __future__ import generators
import pickle

graph = pickle.loads(g)


class priorityDictionary(dict):
    def __init__(self):
#        '''Initialize priorityDictionary by creating binary heap
#of pairs (value,key).  Note that changing or removing a dict entry will
#not remove the old pair from the heap until it is found by smallest() or
#until the heap is rebuilt.'''
        self.__heap = []
        dict.__init__(self)

    def smallest(self):
        '''Find smallest item after removing deleted items from heap.'''
        if len(self) == 0:
            raise IndexError, "smallest of empty priorityDictionary"
        heap = self.__heap
        while heap[0][1] not in self or self[heap[0][1]] != heap[0][0]:
            lastItem = heap.pop()
            insertionPoint = 0
            while 1:
                smallChild = 2*insertionPoint+1
                if smallChild+1 < len(heap) and \
                        heap[smallChild] > heap[smallChild+1]:
                    smallChild += 1
                if smallChild >= len(heap) or lastItem <= heap[smallChild]:
                    heap[insertionPoint] = lastItem
                    break
                heap[insertionPoint] = heap[smallChild]
                insertionPoint = smallChild
        return heap[0][1]
	
    def __iter__(self):
        '''Create destructive sorted iterator of priorityDictionary.'''
        def iterfn():
            while len(self) > 0:
                x = self.smallest()
                yield x
                del self[x]
        return iterfn()
	
    def __setitem__(self,key,val):
#        '''Change value stored in dictionary and add corresponding
#pair to heap.  Rebuilds the heap if the number of deleted items grows
#too large, to avoid memory leakage.'''
        dict.__setitem__(self,key,val)
        heap = self.__heap
        if len(heap) > 2 * len(self):
            self.__heap = [(v,k) for k,v in self.iteritems()]
            self.__heap.sort()  # builtin sort likely faster than O(n) heapify
        else:
            newPair = (val,key)
            insertionPoint = len(heap)
            heap.append(None)
            while insertionPoint > 0 and \
                    newPair < heap[(insertionPoint-1)//2]:
                heap[insertionPoint] = heap[(insertionPoint-1)//2]
                insertionPoint = (insertionPoint-1)//2
            heap[insertionPoint] = newPair
	
    def setdefault(self,key,val):
        '''Reimplement setdefault to call our customized __setitem__.'''
        if key not in self:
            self[key] = val
        return self[key]


def Dijkstra(G,start,end=None):
	"""
	Find shortest paths from the start vertex to all
	vertices nearer than or equal to the end.

	The input graph G is assumed to have the following
	representation: A vertex can be any object that can
	be used as an index into a dictionary.  G is a
	dictionary, indexed by vertices.  For any vertex v,
	G[v] is itself a dictionary, indexed by the neighbors
	of v.  For any edge v->w, G[v][w] is the length of
	the edge.  This is related to the representation in
	<http://www.python.org/doc/essays/graphs.html>
	where Guido van Rossum suggests representing graphs
	as dictionaries mapping vertices to lists of neighbors,
	however dictionaries of edges have many advantages
	over lists: they can store extra information (here,
	the lengths), they support fast existence tests,
	and they allow easy modification of the graph by edge
	insertion and removal.  Such modifications are not
	needed here but are important in other graph algorithms.
	Since dictionaries obey iterator protocol, a graph
	represented as described here could be handed without
	modification to an algorithm using Guido's representation.

	Of course, G and G[v] need not be Python dict objects;
	they can be any other object that obeys dict protocol,
	for instance a wrapper in which vertices are URLs
	and a call to G[v] loads the web page and finds its links.
	
	The output is a pair (D,P) where D[v] is the distance
	from start to v and P[v] is the predecessor of v along
	the shortest path from s to v.
	
	Dijkstra's algorithm is only guaranteed to work correctly
	when all edge lengths are positive. This code does not
	verify this property for all edges (only the edges seen
 	before the end vertex is reached), but will correctly
	compute shortest paths even for some graphs with negative
	edges, and will raise an exception if it discovers that
	a negative edge has caused it to make a mistake.
	"""

	D = {}	# dictionary of final distances
	P = {}	# dictionary of predecessors
	Q = priorityDictionary()   # est.dist. of non-final vert.
	Q[start] = 0
	
	for v in Q:
		D[v] = Q[v]
		if v == end: break
		
		for w in G[v]:
			vwLength = D[v] + G[v][w]
			if w in D:
				if vwLength < D[w]:
					raise ValueError, \
  "Dijkstra: found better path to already-final vertex"
			elif w not in Q or vwLength < Q[w]:
				Q[w] = vwLength
				P[w] = v
	
	return (D,P)
			
def shortestPath(G,start,end):
	"""
	Find a single shortest path from the given start vertex
	to the given end vertex.
	The input has the same conventions as Dijkstra().
	The output is a list of the vertices in order along
	the shortest path.
	"""

	D,P = Dijkstra(G,start,end)
	Path = []
	while 1:
		Path.append(end)
		if end == start: break
		end = P[end]
	Path.reverse()
	return Path

a = shortestPath(graph["edges"], start, end)
# ---------- end dijkstra ----------
python_5 = PythonScript(g=make_graph.g, seq=dijkstra.a)  # -> out, pts; inputs seq: list
# ---------- python_5: Python ----------
from __future__ import generators
import pickle
import rhinoscriptsyntax as rs

graph = pickle.loads(g)

pts = []

for s in seq:
    pts.append(rs.AddPoint(graph["nodes"][s]["coords"]))
# ---------- end python_5 ----------
write_data = PythonScript(path=panel_2)  # -> out
# ---------- write_data: Python ----------
import pickle

a_data = {"meeting room" : [[92.0, 263.0, 0.0], [22.0, 94.5, 15.0]] }

with open(path+"d-12 amenity assignment data.pkl", 'wb') as f:  
    pickle.dump(a_data, f, pickle.HIGHEST_PROTOCOL)
# ---------- end write_data ----------
write_data_2 = PythonScript(path=panel_2, g=make_graph.g, n=make_graph.n_out)  # -> out; disabled
# ---------- write_data_2: Python ----------
import pickle

n_data = pickle.loads(n)
g_data = pickle.loads(g)

with open(path+"d-09 neighborhood data.pkl", 'wb') as f:  
    pickle.dump(n_data, f, pickle.HIGHEST_PROTOCOL)

with open(path+"d-10 graph data.pkl", 'wb') as f:  
    pickle.dump(g_data, f, pickle.HIGHEST_PROTOCOL)
# ---------- end write_data_2 ----------
pline = PolyLine(Vertices=python_5.pts, Closed=False)
previewlw = CustomPreviewLineweights(
    Geometry=pline,
    Shader={ambient=RGB(0, 0, 0), diffuse=RGB(255, 105, 180), emission=RGB(76, 32, 54), shine=0.5, specular=RGB(255, 255, 255), transparency=0},
    Thickness=Slider(7.8, range=0..10))
