# Grasshopper definition visual_distraction_160912.gh (Grasshopper 0.9.76)
# plug-ins: Python Interpreter, HDTReference

# ---- group: Ref Orientation
crv = Curve(<curve referenced from the Rhino model>)

# ---- group: Ref Divider
crv_2 = Curve(<curve referenced from the Rhino model>)

# ----
int = Integer(Slider(2, range=2..3))
concat = Concatenate(FragmentA="desk_orient_", FragmentB=int)
concat_2 = Concatenate(FragmentA="am_", FragmentB=int)
concat_3 = Concatenate(FragmentA="column_", FragmentB=int)
concat_4 = Concatenate(FragmentA="wall_int_", FragmentB=int)
concat_5 = Concatenate(FragmentA="bound_", FragmentB=int)
end = EndPoints(Curve=crv)  # -> Start, End
dpipeline = DynamicGeometryPipeline(
    LayerFilter=concat,
    TypeFilter="Curve",
    NameFilter="*",
    enableFullPath=False,
    GroupByLayer=False,
    GroupByType=False,
    IncludeHidden=True,
    IncludeLocked=True)
dpipeline_2 = DynamicGeometryPipeline(
    LayerFilter=concat_2,
    TypeFilter="Curve",
    NameFilter="*",
    enableFullPath=False,
    GroupByLayer=False,
    GroupByType=False,
    IncludeHidden=True,
    IncludeLocked=True)
dpipeline_3 = DynamicGeometryPipeline(
    LayerFilter=concat_3,
    TypeFilter="Curve",
    NameFilter="*",
    enableFullPath=False,
    GroupByLayer=False,
    GroupByType=False,
    IncludeHidden=True,
    IncludeLocked=True)
dpipeline_4 = DynamicGeometryPipeline(
    LayerFilter=concat_4,
    TypeFilter="Curve",
    NameFilter="*",
    enableFullPath=False,
    GroupByLayer=False,
    GroupByType=False,
    IncludeHidden=True,
    IncludeLocked=True)
dpipeline_5 = DynamicGeometryPipeline(
    LayerFilter=concat_5,
    TypeFilter="Curve",
    NameFilter="*",
    enableFullPath=False,
    GroupByLayer=False,
    GroupByType=False,
    IncludeHidden=True,
    IncludeLocked=True)
xy = XYPlane(Origin=end.Start)
align = AlignPlane(Plane=xy, Direction=crv)  # -> Plane, Angle
crv_3 = Curve(dpipeline)
end_2 = EndPoints(Curve=crv_3)  # -> Start, End
xy_2 = XYPlane(Origin=end_2.Start)
align_2 = AlignPlane(Plane=xy_2, Direction=crv_3)  # -> Plane, Angle
orient = Orient(Geometry=crv_2, Source=align.Plane, Target=align_2.Plane)  # -> Geometry, Transform
crv_4 = Curve(orient.Geometry)

# ---- group: DESK DIVIDERS
crv_5 = Curve(crv_4)

# ----
merge = Merge(Data1=dpipeline_2, Data2=dpipeline_3, Data3=dpipeline_4, Data4=crv_5, Data5=dpipeline_5)  # -> flatten(Result)

# ---- group: OBSTRUCTIONS
crv_6 = Curve(merge)

# ---- group: Orientations
crv_7 = Curve(crv_3)

# ---- group: Positions
pt = Point(end_2.Start)

# ---- group: OBSTRUCTIONS
crv_8 = Curve(crv_6)

# ---- group: DISTRACTION MEASUREMENT
python = PythonScript(pos=pt, orient=crv_7, dist_limit=Slider(40, range=0..100), obstructions=crv_8)  # -> out, neighbor_line, vis_scores; inputs pos: list of Point3d, orient: list of Line, obstructions: list of Curve
# ---------- python: Python ----------
import rhinoscriptsyntax as rs

neighbor_line = []
vis_scores = []
#scores are evaluated as:
#10 - perfect, distraction free
#visible distractions (desks) within range
#negatively impact the score, with reductions
#scaled by position in vision cone
#and distance from individual
for k,p in enumerate(pos):
    score = 10.0
    for i in range(len(pos)):
        
        if pos[i] == p:
            continue
        else:
            #confirm within distance limits
            dist = rs.Distance(p, pos[i])
            if dist < dist_limit:
                #confirm within angle limits
                cxn = rs.AddLine(p, pos[i])
                angle1 = rs.Angle2(orient[k], cxn)[0]
                if angle1 < 110:
                    #check for occlusion
                    blocked = False
                    for ob in obstructions:
                        if blocked:
                            break
                        #limit checked obstructions by distance using closest point
                        closest = rs.EvaluateCurve(ob, rs.CurveClosestPoint(ob,p))
                        if rs.Distance( p, closest ) < dist_limit:
                            if rs.CurveCurveIntersection(cxn, ob):
                                blocked = True
                    if blocked != True:
                        neighbor_line.append(cxn)
                        #nearby objects in periphery
                        if angle1 > 60 and dist <= dist_limit/2.0:
                            score -= 0.5
                        #distant objects in periphery
                        elif angle1 > 60:
                            score -= 0.25
                        #nearby object in central cone
                        elif angle1 <= 60 and dist <= dist_limit/2.0:
                            score -= 1.0
                        #distant objects in central cone
                        else:
                            score -= 0.5
    vis_scores.append(score)
# ---------- end python ----------

# ---- group: Aggregate Scoring by Neighborhood (for Workstyle Metric)
concat_6 = Concatenate(FragmentA="neighborhood_bound_", FragmentB=int)
dpipeline_6 = DynamicGeometryPipeline(
    LayerFilter=concat_6,
    TypeFilter="Curve",
    NameFilter="*",
    enableFullPath=False,
    GroupByLayer=False,
    GroupByType=False,
    IncludeHidden=True,
    IncludeLocked=True)
crv_9 = Curve(dpipeline_6)
area = Area(Geometry=crv_9)  # -> Area, Centroid
lng = ListLength(List=area.Centroid)
python_2 = PythonScript(pt=pt, bound=dpipeline_6, score=python.vis_scores)  # -> out, n_score; inputs pt: list of Point3d, bound: list of Curve, score: list
# ---------- python_2: Python ----------
import rhinoscriptsyntax as rs

n_tab = [ [] for i in range(len(bound))]

for i,p in enumerate(pt):
    for k,n in enumerate(bound):
        if rs.PointInPlanarClosedCurve(p,n):
            n_tab[k].append( score[i] )

n_score = []


for n in n_tab:
    n_score.append( sum(n)/len(n) )
    
print n_score
# ---------- end python_2 ----------
points = PointList(Points=area.Centroid, Size=Slider(10, range=0..10))
series = Series(Start=8, Step=1, Count=lng)
int_2 = Integer(series)
data = Data([1, 2, 3, 4, 5, 6, 7])
data_2 = Data(int_2)
data_3 = Data(python_2.n_score)
data_4 = Data([9.060344828, 8.447916667, 8.339285714, 10, 8.75, 7.4375, 8.370689655])
merge_2 = Merge(Data1=data, Data2=data_2)
merge_3 = Merge(Data1=data_4, Data2=data_3)
data_5 = Data(merge_2)
data_6 = Data(merge_3)
panel = Panel(data_5)
panel_2 = Panel(data_6)

# ---- group: VIZ
angle = Angle(VectorA=crv_7, VectorB=python.neighbor_line)  # -> Angle, Reflex
deg = Degrees(Radians=angle.Angle)
gradient = Gradient(
    LowerLimit="10.0",
    UpperLimit="0.0",
    Parameter=python.vis_scores,
    stops=[0: RGB(0, 128, 0), 0.5: RGB(255, 255, 0), 1: RGB(255, 0, 0)])
multiplication = Multiplication(A=python.vis_scores, B=Slider(0.25, range=0..1))
avr = Average(Input=python.vis_scores)
gradient_2 = Gradient(LowerLimit="180", UpperLimit=0, Parameter=deg, stops=[0: RGB(0, 128, 0), 0.5: RGB(255, 255, 0), 1: RGB(255, 0, 0)])
multiplication_2 = Multiplication(A=avr, B=10)
dash = DashPattern(Curve=python.neighbor_line, Pattern=".25,0.25")  # -> simplify(Dashes), Gaps
number_slider = Slider(2, range=0..2)
cir = Circle(Plane=pt, Radius=multiplication)
int_3 = Integer(multiplication_2)
Z = UnitZ(Factor=1)
col = Colour(simplify(graft(gradient_2)))
division = Division(A=int_3, B=10)
mesh = Mesh(cir)
move = Move(Geometry=mesh, Motion=Z)  # -> Geometry, Transform
previewlw = CustomPreviewLineweights(Geometry=dash.Dashes, Shader=col, Thickness=number_slider)
preview = CustomPreview(Geometry=move.Geometry, Shader=gradient)
previewlw_2 = CustomPreviewLineweights(Geometry=cir, Shader="black", Thickness=number_slider)

# ----
panel_3 = Panel(division)
